# Dynamo graph CubeUnfolding.dyn (Dynamo 0.7.2.20192)

code_block = CodeBlock { 5; }
byLengths = Cuboid.ByLengths(code_block, code_block, code_block)
faces = Topology.Faces(byLengths)
unfoldListOfFaces = DynamoUnfold.Unfolding.UnfoldListOfFaces(faces)
surfaceGeometry = Face.SurfaceGeometry(faces)
code_block_2 = CodeBlock { 17; }
translate = Geometry.Translate(surfaceGeometry, code_block_2)
unfoldListOfSurfaces = DynamoUnfold.Unfolding.UnfoldListOfSurfaces(translate)
