# Dynamo graph SphereUnfold.dyn (Dynamo 0.7.2.18684)

origin = Point.Origin()
code_block = CodeBlock { 10; }
byCenterPointRadius = Sphere.ByCenterPointRadius(origin, code_block)
bySolid = PolySurface.BySolid(byCenterPointRadius)
surfaces = PolySurface.Surfaces(bySolid)
flatten = Flatten(surfaces)
code_block_2 = CodeBlock { 0..1..#15; 0..1..#10; }
pointAtParameter = Surface.PointAtParameter(flatten, code_block_2.out0, code_block_2.out1, lacing=CrossProduct)
code_block_3 = CodeBlock { 1; }
flatten_2 = List.Flatten(pointAtParameter, code_block_3)
transpose = List.Transpose(flatten_2)
byPoints = PolyCurve.ByPoints(transpose)
flatten_3 = Flatten(byPoints)
code_block_4 = CodeBlock { 0..1; 1; }
sublists = List.Sublists(flatten_3, code_block_4.out0, code_block_4.out1)
code_block_5 = CodeBlock(l=sublists) { List.Count(l) - 1; }
removeItemAtIndex = List.RemoveItemAtIndex(sublists, code_block_5)
byLoft = Surface.ByLoft(removeItemAtIndex)
explode = Geometry.Explode(byLoft)
unfoldListOfSurfaces = DynamoUnfold.Unfolding.UnfoldListOfSurfaces(explode)
surfaces_2 = PolySurface.Surfaces(unfoldListOfSurfaces)
perimeterCurves = Surface.PerimeterCurves(surfaces_2)
