# Dynamo graph findrulinglinessimple.dyn (Dynamo 0.8.0.706)

code_block = CodeBlock { Point.ByCoordinates(0,10,0); Point.ByCoordinates(5,5,0); Point.ByCoordinates(2,4,0); }
byThreePoints = Arc.ByThreePoints(firstPoint=code_block.out0, secondPoint=code_block.out1, thirdPoint=code_block.out2)
code_block_2 = CodeBlock { Point.ByCoordinates(0,10,2); Point.ByCoordinates(5,5,2); Point.ByCoordinates(2,4,2); }
byThreePoints_2 = Arc.ByThreePoints(firstPoint=code_block_2.out0, secondPoint=code_block_2.out1, thirdPoint=code_block_2.out2)
create = List.Create(byThreePoints, byThreePoints_2)
byLoft = Surface.ByLoft(create)
code_block_3 = CodeBlock { 0.05; }
findRulingPatches = DynamoUnfold.Unfolding__experimental._findRulingPatches(byLoft, code_block_3)
flatten = Flatten(findRulingPatches)
unfoldListOfSurfaces = DynamoUnfold.Unfolding.UnfoldListOfSurfaces(flatten)
perimeterCurves = Surface.PerimeterCurves(unfoldListOfSurfaces)
code_block_4 = CodeBlock { Point.ByCoordinates(0,0,0); Point.ByCoordinates(0,0,5); }
code_block_5 = CodeBlock { 4; }
byPointsRadius = Cone.ByPointsRadius(code_block_4.out0, code_block_4.out1, code_block_5)
explode = Geometry.Explode(byPointsRadius)
code_block_6 = CodeBlock(a=explode) { a[0]; }
byCenterPointRadius = Circle.ByCenterPointRadius(centerPoint=code_block_4.out0, radius=code_block_5)
code_block_7 = CodeBlock { 0.5; }
horizontalFrameAtParameter = Curve.HorizontalFrameAtParameter(byCenterPointRadius, code_block_7)
ZXPlane = CoordinateSystem.ZXPlane(horizontalFrameAtParameter)
split = Geometry.Split(geometry=code_block_6, other=ZXPlane)
code_block_8 = CodeBlock(a=split) { a[0]; }
findRulingLines = DynamoUnfold.Unfolding__experimental._findRulingLines(code_block_8, code_block_3)
